# Dynamo graph 01 export excel.dyn (Dynamo 2.12.1.8246)

file_path = Filename(".\export_excel.xlsx")
code_block = CodeBlock()
# ---------- code_block.designscript (11 lines) ----------
[
"Name",
"Number",
"Ocucupancy",
"Department",
"Base Finish",
"Ceiling Finish",
"Wall Finish",
"Floor Finish",
"Ocuupant"
];
# ----------------------------------------
code_block_2 = CodeBlock { "Rooms"; }
byName = Category.ByName(name=code_block_2)
all_elements_of_category = ElementsOfCategory(Category=byName)
number = Room.Number(room=all_elements_of_category)
name = Room.Name(room=all_elements_of_category)
list_create = List.Create(item0=number, item1=name)
transpose = List.Transpose(lists=list_create)
addItemToFront = List.AddItemToFront(item=code_block, list=transpose)
code_block_3 = CodeBlock(filepath=file_path, data=addItemToFront) { filepath; "Room Data"; 0; 0; data; true; true; }
exportToExcel = Data.ExportToExcel(filePath=code_block_3.filepath, sheetName=code_block_3.out1, startRow=code_block_3.out2, startColumn=code_block_3.out3, data=code_block_3.data, overWrite=code_block_3.out5, writeAsString=code_block_3.out6)
