# Dynamo graph 02 import data from excel.dyn (Dynamo 2.12.1.8246)

code_block = CodeBlock { "Rooms"; }
byName = Category.ByName(name=code_block)
all_elements_of_category = ElementsOfCategory(Category=byName)
code_block_2 = CodeBlock { "Department"; }
file_path = Filename(".\02-Room_Data.xlsx")
file_from_path = FileObject(path=file_path)
code_block_3 = CodeBlock { "Room data"; true; false; }
importExcel = Data.ImportExcel(file=file_from_path, sheetName=code_block_3.out0, readAsStrings=code_block_3.out1, showExcel=code_block_3.out2)
deconstruct = List.Deconstruct(list=importExcel)
code_block_4 = CodeBlock { [0,1]; }
getItemAtIndex = List.GetItemAtIndex(list=deconstruct.rest@L2, index=code_block_4)
concat = String.Concat(string0=getItemAtIndex)
flatten = List.Flatten(list=concat)
code_block_5 = CodeBlock { 2; }
getItemAtIndex_2 = List.GetItemAtIndex(list=deconstruct.rest@L2, index=code_block_5)
byKeysValues = DesignScript.Builtin.Dictionary.ByKeysValues(keys=flatten, values=getItemAtIndex_2)
name = Room.Name(room=all_elements_of_category)
number = Room.Number(room=all_elements_of_category)
code_block_6 = CodeBlock(x=name, y=number) { x+y; }
valueAtKey = DesignScript.Builtin.Dictionary.ValueAtKey(dictionary=byKeysValues, key=code_block_6)
setParameterByName = Element.SetParameterByName(element=all_elements_of_category, parameterName=code_block_2, value=valueAtKey)
