# Dynamo graph 03 place electrical fixture.dyn (Dynamo 2.12.1.8246)
# packages: Data-Shapes 2022.2.106, Clockwork for Dynamo 2.x 2.6.0

family_types = FamilyTypes("RJ45:RJ45")
select_model_elements = DSModelElementsSelection()  # 11 picked in the model
getLocation = Element.GetLocation(element=select_model_elements)
drawers_direction = Python(IN[0]=select_model_elements)  # IronPython2
# ---------- drawers_direction.python (44 lines) ----------
__author__ = 'Mohsin Sarwar, sm.mohsinsarwar@gmail.com'
import sys
import clr

clr.AddReference('ProtoGeometry')
from Autodesk.DesignScript.Geometry import *

clr.AddReference('RevitNodes')
import Revit
clr.ImportExtensions(Revit.GeometryConversion)
clr.ImportExtensions(Revit.Elements)

clr.AddReference('RevitAPI')
from Autodesk.Revit.DB import *
from Autodesk.Revit.DB.ExtensibleStorage import *
from Autodesk.Revit.DB.Structure import *

clr.AddReference('RevitAPIUI')
from Autodesk.Revit.UI import *

clr.AddReference('RevitServices')
import RevitServices
from RevitServices.Persistence import DocumentManager
from RevitServices.Transactions import TransactionManager

clr.AddReference('System')
from System.Collections.Generic import *

doc = DocumentManager.Instance.CurrentDBDocument
uidoc=DocumentManager.Instance.CurrentUIApplication.ActiveUIDocument

electrical_fixtures = [UnwrapElement(elem) for elem in IN[0]]

vectors = []
for elem in electrical_fixtures:
	transform = elem.GetTotalTransform()
	yaxis = transform.BasisY
	reverse_yaxis = yaxis.Negate()
	vectors.append(reverse_yaxis)

#convert revit vector to dynamo vector
vectors = [vec.ToVector() for vec in vectors]

OUT = vectors
# ----------------------------------------
python_script = Python()  # IronPython2; unwired: IN[0]
# ---------- python_script.python (56 lines) ----------
__author__ = 'Mohsin Sarwar, sm.mohsinsarwar@gmail.com'

import sys
import clr

clr.AddReference('ProtoGeometry')
from Autodesk.DesignScript.Geometry import *

clr.AddReference('RevitNodes')
import Revit
clr.ImportExtensions(Revit.GeometryConversion)
clr.ImportExtensions(Revit.Elements)

clr.AddReference('RevitAPI')
import Autodesk.Revit.DB as DB
from Autodesk.Revit.DB.ExtensibleStorage import *
from Autodesk.Revit.DB.Structure import *

clr.AddReference('RevitAPIUI')
from Autodesk.Revit.UI import *

clr.AddReference('RevitServices')
import RevitServices
from RevitServices.Persistence import DocumentManager
from RevitServices.Transactions import TransactionManager

clr.AddReference('System')
from System.Collections.Generic import *

doc = DocumentManager.Instance.CurrentDBDocument
uidoc=DocumentManager.Instance.CurrentUIApplication.ActiveUIDocument

all_views = DB.FilteredElementCollector(doc) \
			  .OfClass(DB.View3D) \
			  .WhereElementIsNotElementType() \
			  .ToElements()

view_name = "_dynamo_raybounce_analysis"
view_exist = view_name  in [view.Name for view in all_views]

if view_exist:
	OUT = [view for view in all_views if view.Name == view_name]
else:
	# Create 3D view
	TransactionManager.Instance.EnsureInTransaction(doc)
	
	default_3dview_type = doc.GetDefaultElementTypeId(DB.ElementTypeGroup.ViewType3D)
	nview = DB.View3D.CreateIsometric(doc, default_3dview_type)
	nview.Name = view_name
	nview.CropBoxActive = False
	nview.CropBoxVisible = False
	if nview.CanToggleBetweenPerspectiveAndIsometric():
		nview.ToggleToIsometric()
		#nview.ToggleToPerspective() 
	TransactionManager.Instance.TransactionTaskDone()       
	OUT = nview
# ----------------------------------------
code_block = CodeBlock { "Walls"; }
byName = Category.ByName(name=code_block)
code_block_2 = CodeBlock { false; }
raybounce_on_link_category = Custom[RayBounce On Link Category](Points=getLocation, Direction=drawers_direction, ThreeDView=python_script, Category=byName, BounceOnLinksOnly=code_block_2, lacing=Longest)  # package Data-Shapes; Same functionality as raybounce but takes linked model elements into account
flatten = List.Flatten(list=raybounce_on_link_category.Points)
level = Custom[Element.Level](element=select_model_elements)  # package Clockwork for Dynamo 2.x; Gets an element's level
byPointAndLevel = FamilyInstance.ByPointAndLevel(familyType=family_types, point=flatten, level=level)
YAxis = Vector.YAxis()
ZAxis = Vector.ZAxis()
angleAboutAxis = Vector.AngleAboutAxis(vector=drawers_direction, otherVector=YAxis, rotationAxis=ZAxis)
setRotation = FamilyInstance.SetRotation(familyInstance=byPointAndLevel, degree=angleAboutAxis)
code_block_3 = CodeBlock { "Offset from Host"; }
code_block_4 = CodeBlock { 0.3; }
setParameterByName = Element.SetParameterByName(element=setRotation, parameterName=code_block_3, value=code_block_4)
