# Dynamo graph 04 placing switches for each single dffoor.dyn (Dynamo 2.12.1.8246)
# packages: Clockwork for Dynamo 2.x 2.6.0

family_types = FamilyTypes("Family1:Family1")
code_block = CodeBlock { "0915 x 2134mm"; }
byName = FamilyType.ByName(name=code_block)
all_elements_of_family_type = ElementsOfFamilyType(Family_Type=byName)
host = Custom[Element.Host+](element=all_elements_of_family_type)  # package Clockwork for Dynamo 2.x; Gets an element's host. Unlike the OOTB node FamilyInstance.GetHost it not only works for family instances but also for elements like wall sweeps, foundations, railings, builing pads and topo subregions.
faces = Element.Faces(element=host)
getLocation = Element.GetLocation(element=all_elements_of_family_type)
handOrientation = Custom[FamilyInstance.HandOrientation](familyInstance=all_elements_of_family_type)  # package Clockwork for Dynamo 2.x; Gets the hand orientation of a hosted object (e.g. a window or a door)
reverse = Vector.Reverse(vector=handOrientation)
elementType = Element.ElementType(element=all_elements_of_family_type)
code_block_2 = CodeBlock { "Width"; }
getParameterValueByName = Element.GetParameterValueByName(element=elementType, parameterName=code_block_2)
code_block_3 = CodeBlock(x=getParameterValueByName) { x*0.5+0.5; }
translate = Geometry.Translate(geometry=getLocation, direction=reverse, distance=code_block_3)
facingOrientation = FamilyInstance.FacingOrientation(familyInstance=all_elements_of_family_type)
elementType_2 = Element.ElementType(element=host)
code_block_4 = CodeBlock { "Width"; }
getParameterValueByName_2 = Element.GetParameterValueByName(element=elementType_2, parameterName=code_block_4)
code_block_5 = CodeBlock(x=getParameterValueByName_2) { x*0.5; }
translate_2 = Geometry.Translate(geometry=translate, direction=facingOrientation, distance=code_block_5)
doesIntersect = Geometry.DoesIntersect(geometry=translate_2@L1, other=faces@L2)
filterByBoolMask = List.FilterByBoolMask(list=faces, mask=doesIntersect)
firstItem = List.FirstItem(list=filterByBoolMask.in@L2)
tangentAtVParameter = Surface.TangentAtVParameter(surface=filterByBoolMask.in)
byFace = FamilyInstance.ByFace(familyType=family_types, face=firstItem, location=translate_2, referenceDirection=tangentAtVParameter)
