# Dynamo graph 04 placing switches for each single door.dyn (Dynamo 2.12.1.8246)
# packages: Clockwork for Dynamo 2.x 2.6.0, Genius Loci 2023.7.13

family_types = FamilyTypes("Lightin switch:Lightin switch")
code_block = CodeBlock { "0915 x 2134mm"; }
byName = FamilyType.ByName(name=code_block)
all_elements_of_family_type = ElementsOfFamilyType(Family_Type=byName)
getLocation = Element.GetLocation(element=all_elements_of_family_type)
handOrientation = Custom[FamilyInstance.HandOrientation](familyInstance=all_elements_of_family_type)  # package Clockwork for Dynamo 2.x; Gets the hand orientation of a hosted object (e.g. a window or a door)
reverse = Vector.Reverse(vector=handOrientation)
elementType = Element.ElementType(element=all_elements_of_family_type)
code_block_2 = CodeBlock { "Width"; }
getParameterValueByName = Element.GetParameterValueByName(element=elementType, parameterName=code_block_2)
code_block_3 = CodeBlock(x=getParameterValueByName) { x*0.5+0.5; }
translate = Geometry.Translate(geometry=getLocation, direction=reverse, distance=code_block_3)
facingOrientation = FamilyInstance.FacingOrientation(familyInstance=all_elements_of_family_type)
host = Custom[Element.Host+](element=all_elements_of_family_type)  # package Clockwork for Dynamo 2.x; Gets an element's host. Unlike the OOTB node FamilyInstance.GetHost it not only works for family instances but also for elements like wall sweeps, foundations, railings, builing pads and topo subregions.
elementType_2 = Element.ElementType(element=host)
code_block_4 = CodeBlock { "Width"; }
getParameterValueByName_2 = Element.GetParameterValueByName(element=elementType_2, parameterName=code_block_4)
code_block_5 = CodeBlock(x=getParameterValueByName_2) { x*0.5; }
translate_2 = Geometry.Translate(geometry=translate, direction=facingOrientation, distance=code_block_5)
level = Custom[Element.Level](element=all_elements_of_family_type)  # package Clockwork for Dynamo 2.x; Gets an element's level
byPointAndLevel = FamilyInstance.ByPointAndLevel(familyType=family_types, point=translate_2, level=level)
code_block_6 = CodeBlock { "Offset from Host"; }
code_block_7 = CodeBlock { 1; }
setParameterByName = Element.SetParameterByName(element=byPointAndLevel, parameterName=code_block_6, value=code_block_7)
YAxis = Vector.YAxis()
reverse_2 = Vector.Reverse(vector=YAxis)
ZAxis = Vector.ZAxis()
angleAboutAxis = Vector.AngleAboutAxis(vector=reverse_2, otherVector=facingOrientation, rotationAxis=ZAxis)
element_setrotation = Custom[Element SetRotation](element=setParameterByName, degree=angleAboutAxis)  # package Genius Loci; Set the angle of the element around its local Z-axis. (Same as the Rotate command in Revit)
