# Dynamo graph 05 placing emerzency lighting for each single door.dyn (Dynamo 2.12.1.8246)
# packages: Clockwork for Dynamo 2.x 2.4.0, Clockwork for Dynamo 2.x 2.6.0

family_types = FamilyTypes("Emergency Light:Emergency Light")
code_block = CodeBlock { "0915 x 2134mm"; }
byName = FamilyType.ByName(name=code_block)
all_elements_of_family_type = ElementsOfFamilyType(Family_Type=byName)
getLocation = Element.GetLocation(element=all_elements_of_family_type)
facingOrientation = FamilyInstance.FacingOrientation(familyInstance=all_elements_of_family_type)
reverse = Vector.Reverse(vector=facingOrientation)
list_create = List.Create(item0=facingOrientation, item1=reverse)
transpose = List.Transpose(lists=list_create)
host = Custom[Element.Host+](element=all_elements_of_family_type)  # package Clockwork for Dynamo 2.x; Gets an element's host. Unlike the OOTB node FamilyInstance.GetHost it not only works for family instances but also for elements like wall sweeps, foundations, railings, builing pads and topo subregions.
elementType = Element.ElementType(element=host)
code_block_2 = CodeBlock { "Width"; }
getParameterValueByName = Element.GetParameterValueByName(element=elementType, parameterName=code_block_2)
code_block_3 = CodeBlock(x=getParameterValueByName) { dist=x*0.5; }
translate = Geometry.Translate(geometry=getLocation, direction=transpose, distance=code_block_3)
ZAxis = Vector.ZAxis()
elementType_2 = Element.ElementType(element=all_elements_of_family_type)
code_block_4 = CodeBlock { "Height"; }
getParameterValueByName_2 = Element.GetParameterValueByName(element=elementType_2, parameterName=code_block_4)
code_block_5 = CodeBlock { 0.3; }
code_block_6 = CodeBlock(x=getParameterValueByName_2, offset=code_block_5) { x+offset; }
translate_2 = Geometry.Translate(geometry=translate, direction=ZAxis, distance=code_block_6)
faces = Element.Faces(element=host)
filter_faces = Python(IN[0]=translate_2, IN[1]=faces)  # IronPython2
# ---------- filter_faces.python (48 lines) ----------
__author__= "sm.mohsinsarwar@gmail.xom"
import sys
import clr

clr.AddReference('ProtoGeometry')
from Autodesk.DesignScript.Geometry import *

clr.AddReference('RevitNodes')
import Revit
clr.ImportExtensions(Revit.GeometryConversion)
clr.ImportExtensions(Revit.Elements)

clr.AddReference('RevitAPI')
from Autodesk.Revit.DB import *
from Autodesk.Revit.DB.ExtensibleStorage import *
from Autodesk.Revit.DB.Structure import *

clr.AddReference('RevitAPIUI')
from Autodesk.Revit.UI import *

clr.AddReference('RevitServices')
import RevitServices
from RevitServices.Persistence import DocumentManager
from RevitServices.Transactions import TransactionManager

clr.AddReference('System')
from System.Collections.Generic import *

doc = DocumentManager.Instance.CurrentDBDocument
uidoc=DocumentManager.Instance.CurrentUIApplication.ActiveUIDocument

locations = IN[0]
surfaces = IN[1]

list_faces = []
for i, points in enumerate(locations):
	auxiliar_list_points=[]
	for point in points:
		faces = surfaces[i]
		for face in faces:
			does_intersect = Geometry.DoesIntersect(point, face)
			if does_intersect:
				auxiliar_list_points.append(face)
				break
	list_faces.append(auxiliar_list_points)
				

OUT = list_faces
# ----------------------------------------
normalAtParameter = Surface.NormalAtParameter(surface=filter_faces)
ZAxis_2 = Vector.ZAxis()
reverse_2 = Vector.Reverse(vector=ZAxis_2)
cross = Vector.Cross(vector=normalAtParameter, cross=reverse_2)
byFace = FamilyInstance.ByFace(familyType=family_types, face=filter_faces, location=translate_2, referenceDirection=cross)
code_block_7 = CodeBlock { "Schedule Level"; }
level = Custom[Element.Level](element=all_elements_of_family_type)  # package Clockwork for Dynamo 2.x; Gets an element's level
setParameterByName = Element.SetParameterByName(element=byFace, parameterName=code_block_7, value=level)
