# Dynamo graph 06 minum cable length.dyn (Dynamo 2.12.1.8246)
# packages: MEPover 2022.10.30, Clockwork for Dynamo 2.x 2.6.0, Topologic 1.4.0

code_block = CodeBlock { "Cable Trays"; "Cable Tray Fittings"; "Electrical Fixtures"; }
byName = Category.ByName(name=code_block.out2)
all_elements_of_category = ElementsOfCategory(Category=byName)
getLocation = Element.GetLocation(element=all_elements_of_category)
byName_2 = Category.ByName(name=code_block.out0)
all_elements_of_category_2 = ElementsOfCategory(Category=byName_2)
getLocation_2 = Element.GetLocation(element=all_elements_of_category_2)
byName_3 = Category.ByName(name=code_block.out1)
all_elements_of_category_3 = ElementsOfCategory(Category=byName_3)
mep_connector_info = Custom[MEP Connector info+](element=all_elements_of_category_3)  # package MEPover; This node will return the connectors and a lot of information about those connectors of the input elements

# group: cable tray location network
average = Custom[Point.Average](points=mep_connector_info.Points)  # package Clockwork for Dynamo 2.x; Determines the average of a list of points
byStartPointEndPoint = Line.ByStartPointEndPoint(startPoint=average, endPoint=mep_connector_info.Points)
flatten = List.Flatten(list=byStartPointEndPoint)
join = List.Join(list0=getLocation_2, list1=flatten)

# group: closest point on network for each electrical fixture
distanceTo = Geometry.DistanceTo(geometry=getLocation@L1, other=join)
sortIndexByValue = List.SortIndexByValue(list=distanceTo)
firstItem = List.FirstItem(list=sortIndexByValue@L2)
getItemAtIndex = List.GetItemAtIndex(list=join, index=firstItem)
closestPointTo = Geometry.ClosestPointTo(geometry=getItemAtIndex, other=getLocation)

# group: path from electrical fixture to cable tray
Z = Point.Z(point=closestPointTo)
Z_2 = Point.Z(point=getLocation)
code_block_2 = CodeBlock(x=Z, y=Z_2) { x-y; }
translate = Geometry.Translate(geometry=getLocation, zTranslation=code_block_2)
byStartPointEndPoint_2 = Line.ByStartPointEndPoint(startPoint=getLocation, endPoint=translate)
byStartPointEndPoint_3 = Line.ByStartPointEndPoint(startPoint=translate, endPoint=closestPointTo)

# group: complete network
join_2 = List.Join(list0=byStartPointEndPoint_2, list1=byStartPointEndPoint_3, list2=join, list3=closestPointTo)

byGeometry = Topologic.Topology.ByGeometry(geometry=join_2)
byTopologies = Topologic.Cluster.ByTopologies(topologies=byGeometry)
selfMerge = Topologic.Topology.SelfMerge(topology=byTopologies)
code_block_3 = CodeBlock { 0.01; }
byTopology = Topologic.Graph.ByTopology(topology=selfMerge, tolerance=code_block_3)

# group: start vertex
X = Point.X(point=getLocation)
Y = Point.Y(point=getLocation)
Z_3 = Point.Z(point=getLocation)
verticesAtCoordinates = Topologic.Graph.VerticesAtCoordinates(graph=byTopology, x=X, y=Y, z=Z_3)
flatten_2 = List.Flatten(list=verticesAtCoordinates)

select_point_on_face = DSPointOnElementSelection()  # 1 picked in the model

# group: end vertex
X_2 = Point.X(point=select_point_on_face)
Y_2 = Point.Y(point=select_point_on_face)
Z_4 = Point.Z(point=select_point_on_face)
verticesAtCoordinates_2 = Topologic.Graph.VerticesAtCoordinates(graph=byTopology, x=X_2, y=Y_2, z=Z_4)
flatten_3 = List.Flatten(list=verticesAtCoordinates_2)

shortestPath = Topologic.Graph.ShortestPath(graph=byTopology, startVertex=flatten_2@L1, endVertex=flatten_3)
geometry = Topologic.Topology.Geometry(topology=shortestPath)
flatten_4 = List.Flatten(list=geometry)
curves = PolyCurve.Curves(polyCurve=flatten_4)
number_slider = DoubleSlider(13, range=0..13 step 1)
getItemAtIndex_2 = List.GetItemAtIndex(list=curves, index=number_slider)
startPoint = Curve.StartPoint(curve=getItemAtIndex_2)
endPoint = Curve.EndPoint(curve=getItemAtIndex_2)
code_block_4 = CodeBlock { 0.1; }
byPointsRadius = Cylinder.ByPointsRadius(startPoint=startPoint, endPoint=endPoint, radius=code_block_4)
color_palette = ColorPalette({R: 0, G: 139, B: 139, A: 255})
byGeometryColor = Modifiers.GeometryColor.ByGeometryColor(geometry=byPointsRadius, color=color_palette)
code_block_5 = CodeBlock { "cable_length"; }
length = Curve.Length(curve=flatten_4)
setParameterByName = Element.SetParameterByName(element=all_elements_of_category, parameterName=code_block_5, value=length)
