# Dynamo graph 07 dialux.dyn (Dynamo 2.12.1.8246)
# packages: Genius Loci 2022.6.16

family_types = FamilyTypes("Simple Lights:square")
family_types_2 = FamilyTypes("Simple Lights:downlight")
list_create = List.Create(item0=family_types, item1=family_types_2)
select_model_element = DSModelElementSelection()  # 1 picked in the model
cad_block = Custom[CAD Block](importInstance=select_model_element)  # package Genius Loci; Get the location point, name and layer of the CAD blocks / XRefs from a CAD link or import. Please note : The non-uniform scaling of blocks is not supported (The X, Y and Z values ​​of the Block Scale must be the same).
groupByKey = List.GroupByKey(list=cad_block.OriginPoint, keys=cad_block.LayerName)
pruneDuplicates = Point.PruneDuplicates(points=groupByKey.groups)
byPoint = FamilyInstance.ByPoint(familyType=list_create, point=pruneDuplicates)
code_block = CodeBlock(x=groupByKey.uniqueKeys) { x; }
code_block_2 = CodeBlock { 0; }
getItemAtIndex = List.GetItemAtIndex(list=pruneDuplicates, index=code_block_2)
