# Dynamo graph 08 conecting cable tray.dyn (Dynamo 2.12.1.8246)
# packages: MEPover 2022.10.30

code_block = CodeBlock { "Cable Trays"; "Electrical Fixtures"; }
byName = Category.ByName(name=code_block.out1)
all_elements_of_category = ElementsOfCategory(Category=byName)
getLocation = Element.GetLocation(element=all_elements_of_category)
byName_2 = Category.ByName(name=code_block.out0)
all_elements_of_category_2 = ElementsOfCategory(Category=byName_2)
getLocation_2 = Element.GetLocation(element=all_elements_of_category_2)

# group: filter closest cable tray
distanceTo = Geometry.DistanceTo(geometry=getLocation@L1, other=getLocation_2)
sortIndexByValue = List.SortIndexByValue(list=distanceTo)
firstItem = List.FirstItem(list=sortIndexByValue@L2)
getItemAtIndex = List.GetItemAtIndex(list=getLocation_2, index=firstItem)
closestPointTo = Geometry.ClosestPointTo(geometry=getItemAtIndex, other=getLocation)

# group: path from electrical fixtures to cable tray
Z = Point.Z(point=closestPointTo)
Z_2 = Point.Z(point=getLocation)
code_block_2 = CodeBlock(x=Z, y=Z_2) { x-y; }
translate = Geometry.Translate(geometry=getLocation, zTranslation=code_block_2)
byStartPointEndPoint = Line.ByStartPointEndPoint(startPoint=translate, endPoint=closestPointTo)
byStartPointEndPoint_2 = Line.ByStartPointEndPoint(startPoint=translate, endPoint=getLocation)

list_create = List.Create(item0=byStartPointEndPoint, item1=byStartPointEndPoint_2)
transpose = List.Transpose(lists=list_create)
code_block_3 = CodeBlock { "Electrical Metallic Tubing (EMT)"; }
byName_3 = ElementType.ByName(name=code_block_3)
levels = Levels("Level 1")
code_block_4 = CodeBlock { 0.103; }
byLines = Custom[Conduit.ByLines](Lines=transpose@L2, ConduitType=byName_3, level=levels, Diameter=code_block_4)  # package MEPover; Creates conduits by Line, ConduitType, Level and Diameter
code_block_5 = CodeBlock { 0; 1; }
getItemAtIndex_2 = List.GetItemAtIndex(list=byLines@L2, index=code_block_5.out0)
getItemAtIndex_3 = List.GetItemAtIndex(list=byLines@L2, index=code_block_5.out1)
byMEPCurves = Custom[MEPFitting.ByMEPCurves](MEPCurve1=getItemAtIndex_2, MEPCurve2=getItemAtIndex_3)  # package MEPover; Creates a UnionFitting or ElbowFitting by 2 MEPCurves (Ducts, Cable Trays, Pipes or Conduits). The output may not always be all the fittings created as Revit sometimes creates extra transition fittings outside of the node transactions.
