# Dynamo graph 09 Set height lighting fixtures.dyn (Dynamo 2.12.1.8246)
# packages: Data-Shapes 2022.2.106, Rhythm 2023.7.3

select_model_elements = DSModelElementsSelection()  # 20 picked in the model
ZAxis = Vector.ZAxis()
reverse = Vector.Reverse(vector=ZAxis)
list_create = List.Create(item0=ZAxis, item1=reverse)
getLocation = Element.GetLocation(element=select_model_elements)
python_script = Python()  # IronPython2; unwired: IN[0]
# ---------- python_script.python (51 lines) ----------
import sys
import clr

clr.AddReference('ProtoGeometry')
from Autodesk.DesignScript.Geometry import *

clr.AddReference('RevitNodes')
import Revit
clr.ImportExtensions(Revit.GeometryConversion)
clr.ImportExtensions(Revit.Elements)

clr.AddReference('RevitAPI')
import Autodesk.Revit.DB as DB
from Autodesk.Revit.DB.ExtensibleStorage import *
from Autodesk.Revit.DB.Structure import *

clr.AddReference('RevitAPIUI')
from Autodesk.Revit.UI import *

clr.AddReference('RevitServices')
import RevitServices
from RevitServices.Persistence import DocumentManager
from RevitServices.Transactions import TransactionManager

clr.AddReference('System')
from System.Collections.Generic import *

doc = DocumentManager.Instance.CurrentDBDocument
uidoc=DocumentManager.Instance.CurrentUIApplication.ActiveUIDocument

all_views = DB.FilteredElementCollector(doc) \
              .OfClass(DB.View) \
              .WhereElementIsNotElementType() \
              .ToElements()
try:
	TransactionManager.Instance.EnsureInTransaction(doc)
	
	default_3dview_type = doc.GetDefaultElementTypeId(DB.ElementTypeGroup.ViewType3D)
	nview = DB.View3D.CreateIsometric(doc, default_3dview_type)
	nview.Name = "dynamo_raybounce_analysis"
	nview.CropBoxActive = False
	nview.CropBoxVisible = False
	if nview.CanToggleBetweenPerspectiveAndIsometric():
	    nview.ToggleToIsometric()
	    #nview.ToggleToPerspective() 
	    
	TransactionManager.Instance.TransactionTaskDone()
	            
	OUT = nview
except Exception as e:
	OUT = [view for view in all_views if view.Name=="dynamo_raybounce_analysis"]
# ----------------------------------------
code_block = CodeBlock { ["Ceilings", "Floors"]; }
byName = Category.ByName(name=code_block)
code_block_2 = CodeBlock { false; }
raybounce_on_link_category = Custom[RayBounce On Link Category](Points=getLocation, ThreeDView=python_script, Category=byName, BounceOnLinksOnly=code_block_2)  # package Data-Shapes; Same functionality as raybounce but takes linked model elements into account; unwired: Direction
map = List.Map(list=list_create, function=raybounce_on_link_category.Elements)
transpose = List.Transpose(lists=map)
string_from_object = FromObject(object=transpose)
code_block_3 = CodeBlock { "Ceiling"; }
eq = string_from_object == code_block_3
filterByBoolMask = List.FilterByBoolMask(list=transpose, mask=eq)
isEmpty = List.IsEmpty(list=filterByBoolMask.in@L2)
filterByBoolMask_2 = List.FilterByBoolMask(list=select_model_elements, mask=isEmpty)
code_block_4 = CodeBlock(filtered_mep_fixtures=filterByBoolMask_2.out) { filtered_mep_fixtures; }
getLocation_2 = Element.GetLocation(element=code_block_4)
X = Point.X(point=getLocation_2)
Y = Point.Y(point=getLocation_2)
flatten = List.Flatten(list=filterByBoolMask.in)
ʳʰʸᵗʰᵐ_hostobject_bottomsurface = Rhythm.Revit.Elements.HostObject.BottomSurface(hostObject=flatten)
flatten_2 = List.Flatten(list=ʳʰʸᵗʰᵐ_hostobject_bottomsurface)
pointAtParameter = Surface.PointAtParameter(surface=flatten_2)
Z = Point.Z(point=pointAtParameter)
byCoordinates = Point.ByCoordinates(x=X, y=Y, z=Z)
setLocation = Element.SetLocation(element=code_block_4, geometry=byCoordinates)
