# Dynamo graph 10 Align and rotate.dyn (Dynamo 2.12.1.8246)

select_model_element = DSModelElementSelection()  # 1 picked in the model
select_model_elements = DSModelElementsSelection()  # 20 picked in the model
center_and_align_mep_fixtures = Custom[center_and_align_mep_fixtures](familyInstance=select_model_elements@L1)
