# Dynamo custom node center_and_align_mep_fixtures.dyf (Dynamo 2.12.1.8246)
# category: Mycustomnodes.MEP
# packages: Topologic 1.4.0, Sparrow 2021.2.1, Rhythm 2023.7.3

familyInstance = Input(familyInstance: Revit.Elements.FamilyInstance)

# group: filter ceiling where element is located
code_block = CodeBlock { "Ceilings"; }
byName = Category.ByName(name=code_block)
all_elements_of_category = ElementsOfCategory(Category=byName)
getLocation = Element.GetLocation(element=familyInstance)
ʳʰʸᵗʰᵐ_hostobject_bottomsurface = Rhythm.Revit.Elements.HostObject.BottomSurface(hostObject=all_elements_of_category)
flatten = List.Flatten(list=ʳʰʸᵗʰᵐ_hostobject_bottomsurface)
doesIntersect = Geometry.DoesIntersect(geometry=getLocation, other=flatten)
filterByBoolMask = List.FilterByBoolMask(list=all_elements_of_category, mask=doesIntersect)

getCeilingBoundary = Sparrow.Revit.Ceilings.GetCeilingBoundary(ceiling=filterByBoolMask.in)
flatten_2 = List.Flatten(list=getCeilingBoundary)
byJoinedCurves = PolyCurve.ByJoinedCurves(curves=flatten_2)
byPatch = Surface.ByPatch(closedCurve=byJoinedCurves)
byGeometry = Topologic.Topology.ByGeometry(geometry=byPatch)
getGridCurves = Sparrow.Revit.Ceilings.GetGridCurves(ceiling=filterByBoolMask.in, LinkInstance=filterByBoolMask.in)
flatten_3 = List.Flatten(list=getGridCurves)
join = List.Join(list0=flatten_2, list1=flatten_3)
byGeometry_2 = Topologic.Topology.ByGeometry(geometry=join)
byTopologies = Topologic.Cluster.ByTopologies(topologies=byGeometry_2)
selfMerge = Topologic.Topology.SelfMerge(topology=byTopologies)
slice = Topologic.Topology.Slice(topology=byGeometry, tool=selfMerge)
faces = Topologic.Shell.Faces(shell=slice)
geometry = Topologic.Topology.Geometry(topology=faces)
code_block_2 = CodeBlock { 0.5; }
pointAtParameter = Surface.PointAtParameter(surface=geometry, u=code_block_2, v=code_block_2)
distanceTo = Geometry.DistanceTo(geometry=getLocation, other=pointAtParameter)
sortIndexByValue = List.SortIndexByValue(list=distanceTo)
firstItem = List.FirstItem(list=sortIndexByValue)
getItemAtIndex = List.GetItemAtIndex(list=pointAtParameter, index=firstItem)
X = Point.X(point=getItemAtIndex)
Y = Point.Y(point=getItemAtIndex)
filterByBoolMask_2 = List.FilterByBoolMask(list=flatten, mask=doesIntersect)
pointAtParameter_2 = Surface.PointAtParameter(surface=filterByBoolMask_2.in)
Z = Point.Z(point=pointAtParameter_2)
byCoordinates = Point.ByCoordinates(x=X, y=Y, z=Z)
setLocation = Element.SetLocation(element=familyInstance, geometry=byCoordinates)
getItemAtIndex_2 = List.GetItemAtIndex(list=geometry, index=firstItem)
perimeterCurves = Surface.PerimeterCurves(surface=getItemAtIndex_2)
direction = Line.Direction(line=perimeterCurves)
XAxis = Vector.XAxis()
ZAxis = Vector.ZAxis()
angleAboutAxis = Vector.AngleAboutAxis(vector=direction, otherVector=XAxis, rotationAxis=ZAxis)
minimumItem = List.MinimumItem(list=angleAboutAxis)
setRotation = FamilyInstance.SetRotation(familyInstance=familyInstance, degree=minimumItem)
FamilyInstance = Output(setRotation)
