# Dynamo graph Wifi heatmap.dyn (Dynamo 2.12.1.8246)

current = Document.Current()
activeView = Document.ActiveView(document=current)
select_face = DSFaceSelection()  # 1 picked in the model
code_block = CodeBlock { 0..1..#15; }
pointAtParameter = Surface.PointAtParameter(surface=select_face, u=code_block, v=code_block, lacing=CrossProduct)
flatten = List.Flatten(list=pointAtParameter)
UVParameterAtPoint = Surface.UVParameterAtPoint(surface=select_face, point=flatten, lacing=Longest)
select_model_element = DSModelElementSelection()  # 1 picked in the model
getLocation = Element.GetLocation(element=select_model_element)
distanceTo = Geometry.DistanceTo(geometry=getLocation, other=flatten)
frequency_ghz = CodeBlock { 5; }
access_point_power_dbm = CodeBlock { 15; }
code_block_2 = CodeBlock(distance=distanceTo, freq=frequency_ghz, access_point=access_point_power_dbm)
# ---------- code_block_2.designscript (7 lines) ----------
FSPL = 20*Math.Log10(distance*0.001)
+
20*Math.Log10(freq)
+
92.45;

access_point - FSPL;
# ----------------------------------------
VIEW_NAME = CodeBlock { "Wifi Analysis (dbm)"; }
code_block_3 = CodeBlock { "Wifi HeatMap"; }
unit_types = UnitTypes("Length")
byViewFacePointsAndValues = Revit.AnalysisDisplay.FaceAnalysisDisplay.ByViewFacePointsAndValues(view=activeView, surface=select_face, sampleLocations=UVParameterAtPoint, samples=code_block_2.out1, name=VIEW_NAME, description=code_block_3, unitType=unit_types)
