# Dynamo graph powerbi.dyn (Dynamo 2.12.1.8246)

# group: Revit 2022 Revit Internal Units = Meters Revit language = English
# note: .

# group: collect all rooms
categories = Categories("OST_Rooms")  # graph input
current = Document.Current()
activeView = Document.ActiveView(document=current)
all_elements_of_category_in_view = ElementsOfCategoryInView(Category=categories, View=activeView)

# group: EXPORT DATA TO EXCEL
file_path = Filename(".\revit_data.xlsx")
code_block = CodeBlock { "summary"; }
code_block_2 = CodeBlock { 0; }
header = CodeBlock()
# ---------- header.designscript (6 lines) ----------
[
"Id",
"Name",
"Area",
"Perimeter"
];
# ----------------------------------------
id = Element.Id(element=all_elements_of_category_in_view)
code_block_3 = CodeBlock { " "; }
code_block_4 = CodeBlock()
# ---------- code_block_4.designscript (6 lines) ----------
[
"Name",
"Number",
"Area",
"Perimeter"
];
# ----------------------------------------
getParameterValueByName = Element.GetParameterValueByName(element=all_elements_of_category_in_view@L1, parameterName=code_block_4)
code_block_5 = CodeBlock { [0,1]; }
getItemAtIndex = List.GetItemAtIndex(list=getParameterValueByName@L2, index=code_block_5)
join = String.Join(separator=code_block_3, string0=getItemAtIndex)
flatten = List.Flatten(list=join)
code_block_6 = CodeBlock { 2; 3; }
getItemAtIndex_2 = List.GetItemAtIndex(list=getParameterValueByName@L2, index=code_block_6.out0)
getItemAtIndex_3 = List.GetItemAtIndex(list=getParameterValueByName@L2, index=code_block_6.out1)
list_create = List.Create(item0=id, item1=flatten, item2=getItemAtIndex_2, item3=getItemAtIndex_3)
transpose = List.Transpose(lists=list_create)
addItemToFront = List.AddItemToFront(item=header, list=transpose)
code_block_7 = CodeBlock { true; }
exportToExcel = Data.ExportToExcel(filePath=file_path, sheetName=code_block, startRow=code_block_2, startColumn=code_block_2, data=addItemToFront, overWrite=code_block_7)

# group: pick svg file location
file_path_2 = Filename(".\revit_floor.svg")  # graph input

# group: Room Boundaries
coreBoundary = Room.CoreBoundary(room=all_elements_of_category_in_view)

# group: Remove Rooms struture pilars holes
byJoinedCurves = PolyCurve.ByJoinedCurves(curves=coreBoundary)
byPatch = Surface.ByPatch(closedCurve=byJoinedCurves)
area = Surface.Area(surface=byPatch)
n250_mm = CodeBlock { 0.25; }  # "250 mm"
gt = area > n250_mm
filterByBoolMask = List.FilterByBoolMask(list=coreBoundary, mask=gt)

# group: find the outer boundary using perimenter length last item in the list is the outer boundary
byJoinedCurves_2 = PolyCurve.ByJoinedCurves(curves=filterByBoolMask.in)
length = Curve.Length(curve=byJoinedCurves_2)
sortIndexByValue = List.SortIndexByValue(list=length)
getItemAtIndex_4 = List.GetItemAtIndex(list=filterByBoolMask.in@L3, index=sortIndexByValue@L2)
lastItem = List.LastItem(list=getItemAtIndex_4@@L3)

# group: convert curves in to list of points_at_equal_length
points_at_equal_length = Python(IN[0]=lastItem)  # IronPython2
# ---------- points_at_equal_length.python (34 lines) ----------
import sys
import clr
clr.AddReference('ProtoGeometry')
from Autodesk.DesignScript.Geometry import *

def points_at_equal_length(curve):
	curve_points = []
	if type(curve) is not Line:
		# The curve is not a Line
		start_point = curve.StartPoint
		points_on_curve = Curve.PointsAtEqualChordLength(curve,100)
		
		curve_points.append(start_point)
		curve_points.extend(points_on_curve)
		
	else:
		# The curve is a Line
		start_point = curve.StartPoint
		curve_points.append(start_point)
	
	#curve_2dpoints = [point3d_as_2dtuple(point) for point in curve_points]
	return curve_points

rooms_loops = IN[0]

aproximate_curves_as_points = []
for room_loop in rooms_loops:
	_aux_array = []
	for curve in room_loop:
		points = points_at_equal_length(curve)
		_aux_array.extend(points)
	aproximate_curves_as_points.append(_aux_array)
	
OUT = aproximate_curves_as_points
# ----------------------------------------

# group: svg size
flatten_2 = List.Flatten(list=points_at_equal_length)
byGeometry = BoundingBox.ByGeometry(geom=flatten_2)
maxPoint = BoundingBox.MaxPoint(boundingBox=byGeometry)
X = Point.X(point=maxPoint)
minPoint = BoundingBox.MinPoint(boundingBox=byGeometry)
X_2 = Point.X(point=minPoint)
Y = Point.Y(point=maxPoint)
Y_2 = Point.Y(point=minPoint)
svg_width_height = CodeBlock(xmax=X, xmin=X_2, ymax=Y, ymin=Y_2) { width=xmax-xmin; height=ymax-ymin; {"width":width,"height":height}; }

# group: Move every polygon_corners to positive quadrant
code_block_8 = CodeBlock(y=X_2, x=X) { y-x; }
translate = Geometry.Translate(geometry=maxPoint, xTranslation=code_block_8)
byOrigin = CoordinateSystem.ByOrigin(origin=translate)
byCoordinates = Point.ByCoordinates()
byOrigin_2 = CoordinateSystem.ByOrigin(origin=byCoordinates)
transform = Geometry.Transform(geometry=points_at_equal_length, fromCoordinateSystem=byOrigin, contextCoordinateSystem=byOrigin_2)
XZ = Plane.XZ()
mirror = Geometry.Mirror(geometry=transform, mirrorPlane=XZ)

# group: convert dynamo point to a svg coordinate
prepare_coordinates_as_str = Python(IN[0]=mirror)  # IronPython2
# ---------- prepare_coordinates_as_str.python (39 lines) ----------
#msarwar@jgingenieros.es
import sys
import clr
clr.AddReference('ProtoGeometry')
from Autodesk.DesignScript.Geometry import *
import clr
clr.AddReference('DSCoreNodes')
from DSCore import *

def point3d_to_2d(point):
	return (point.X, point.Y)

def convert_point_to_str(point):
	x = str(Math.Round(point.X, 2))
	y = str(Math.Round(point.Y, 2))
	
	point_as_str = r'{},{}'.format(x, y)
	return point_as_str
	
def polygon_centroid(points):
	average_x = sum([point.X for point in points])/len(points)
	average_y = sum([point.Y for point in points])/len(points)
	return r'{},{}'.format(round(average_x, 2), round(average_y, 2))
	
polygons_corners = IN[0]

polygons_data = []
for polygon in polygons_corners:
	_aux_array = []
	for point in polygon:
		_aux_array.append(convert_point_to_str(point))
	centroid = polygon_centroid(polygon)

	corners = " ".join(_aux_array)
	
	data = {'corners':corners, 'centroid':centroid}
	polygons_data.append(data)
	
OUT = polygons_data
# ----------------------------------------

# group: WRITE SVG file
inputs = CodeBlock(file_path=file_path_2, svg_size=svg_width_height.out2, polygon_data=prepare_coordinates_as_str, revit_rooms=all_elements_of_category_in_view) { file_path; svg_size; polygon_data; revit_rooms; }
write_svg = Python(IN[0]=inputs.file_path, IN[1]=inputs.svg_size, IN[2]=inputs.polygon_data, IN[3]=inputs.revit_rooms)  # IronPython2
# ---------- write_svg.python (43 lines) ----------
path = IN[0]
size = IN[1]
width, height = size['width'], size['height']
polygons_data = IN[2]
rooms = UnwrapElement(IN[3])

simple_polygon_svg_template = r'<polygon id = "{}"  points="{}" style="stroke-width:0.25" />'

def create_svg_header(width, height):
    return r'<svg height="{}" width="{}">'.format(height, width)

def create_polygon_element(polygon_id, polygon_corners):
    return r'<polygon id="{}" points="{}" style="stroke-width:0.25" />'.format(polygon_id, polygon_corners) 
    
def create_polygon_tag(centroid, text):
	centroid = centroid.split(',')
	x = centroid[0]
	y = centroid[1]	
	
	return r'<text x="{}" y="{}" font-family="Arial" font-size="0.5" fill="blue">{}</text>'.format(x,y,text)
	
def save_svg_file(path, content):
    with open(path, 'w') as f:
        f.write(content)

svg_content = create_svg_header(width, height)
x = []
for room, polygon in zip(rooms, polygons_data):
	room_id = str(room.Id)
	room_name_parameter = room.LookupParameter('Name')
	room_name = 'Room'
	if room_name_parameter:
		room_name = room_name_parameter.AsValueString()
	
	svg_content += '\n'
	svg_content += create_polygon_element(room_id, polygon['corners'])
	svg_content += '\n'
	svg_content += create_polygon_tag(polygon['centroid'], room_name)

svg_content += '</svg>'	
save_svg_file(path, svg_content) 
    
OUT = svg_content
# ----------------------------------------
